# Grasshopper definition 2018-06-02-script.gh (Grasshopper 0.9.76)
# plug-ins: Python Interpreter

to_left_test = PythonScript()  # -> Out, A
vec = VectorXYZ(XComponent=6, YComponent=3, ZComponent=0)  # -> Vector, Length
vec_2 = VectorXYZ(XComponent=2, YComponent=2, ZComponent=0)  # -> Vector, Length
vec_3 = VectorXYZ(XComponent=4, YComponent=1.2, ZComponent=0)  # -> Vector, Length
vec_4 = VectorXYZ(XComponent=1.5, YComponent=2, ZComponent=2)  # -> Vector, Length
pt = Point(vec.Vector)
pt_2 = Point(vec_2.Vector)
pt_3 = Point(vec_3.Vector)
pt_4 = Point(vec_4.Vector)
triangle = PythonScript()  # -> lines
# ---------- triangle: Python ----------
import rhinoscriptsyntax as rs

lst = []
PointA = rs.AddPoint(1,1,0)
PointB = rs.AddPoint(6,1,0)
PointC = rs.AddPoint(1,3,0)

lst.append(PointA)
lst.append(PointB)
lst.append(PointC)

lines = []
for i in range(0, len(lst)):
    for j in range(i, len(lst)):
        
        lines.append(rs.AddLine(lst[i], lst[j]))
# ---------- end triangle ----------
