# Grasshopper definition 2018-06-03-Graham_Scan.gh (Grasshopper 0.9.76)
# plug-ins: Python Interpreter

ltl = PythonScript()  # -> pts, LTL
# ---------- ltl: Python ----------
import rhinoscriptsyntax as rs
import random
import Rhino.Geometry as rg


def addNewPoints(Points, size):
    
    for i in range(0, size):
        pt = rg.Point2d(random.randrange(1,51), random.randrange(1,51))
        Points.append(pt)
    return Points


def getLTL(Points):
    LTL = Points[0]
    for i in range(1, len(Points)):
        if Points[i].Y < LTL.Y:
            LTL = Points[i]
        elif Points[i].Y == LTL.Y:
            if Points[i].X < LTL.X:
                LTL = Points[i]
    return LTL





newPoints = []
Points = addNewPoints(newPoints, 20)
LTL = getLTL(Points)
pts = []
for pt in Points:
    if pt.X == LTL.X and pt.Y == LTL.Y:
        continue
    else:
        pts.append(pt)
# ---------- end ltl ----------
pt = Point(ltl.LTL)
graham_scan = PythonScript(Points=ltl.pts, LTL=pt)  # -> sortedPoints, resultPoints; inputs Points: list of Point3d, LTL: Point3d
# ---------- graham_scan: Python ----------
import Rhino.Geometry as rg
import rhinoscriptsyntax as rs
import math

def preOrder(LTL, Points):
    angles = []
    for i in range(0, len(Points)):
        angle = getAngle(LTL, Points[i], rg.Point2d(-1, LTL.Y))
        angles.append(angle)
    print(angles)
    return angles

def getAngle(srcPt, p1, p2):
    """Get Angle from 3 Points"""
    #   vector a (x, y) 
    va_x = p1.X - srcPt.X
    va_y = p1.Y - srcPt.Y
    
    #   vector b (x, y)
    vb_x = p2.X - srcPt.X
    vb_y = p2.Y - srcPt.Y
    
    #   production of 2 vectors
    productValue = (va_x * vb_x) + (va_y * vb_y)
    #    print("productValue", productValue)
    #   length va
    va_val = math.sqrt(va_x * va_x + va_y * va_y)
    #   length vb
    vb_val = math.sqrt(vb_x * vb_x + vb_y * vb_y)
    #   cos
    cosValue = productValue/(va_val * vb_val)
    if cosValue == 1:
        angle = 0
    elif cosValue == -1:
        angle = 180
    else:
        angle = math.acos(cosValue)*180/math.pi
    
    return angle

def sortPoints(Angles, Points):
    res = [x for _,x in sorted(zip(Angles,Points))]
    return res

def findExtreme(firstPt, secondPt, canPts):
    """first extrem point, second extrem point 
    and list of points as candidates, which are already sorted by angles"""
    # we need 2 stacks    
    stack_S = [firstPt, secondPt]
    print(secondPt.X, secondPt.Y)
    stack_T = canPts
    print('length of stack_S', len(stack_S))
    print('length of stack_T', len(stack_T))

    while stack_T:
        print('length of stack_S', len(stack_S))
        print('length of stack_T', len(stack_T))
        currentSecondPt = stack_S[-1]
        currentFirstPt = stack_S[-2]
        nextPt = stack_T[-1]
        if isLeft(currentFirstPt, currentSecondPt, nextPt):
            stack_S.append(stack_T.pop())

        else:
            stack_S.pop()
    
    return stack_S



def isLeft(firstPt, secondPt, testPt):
    v1 = rg.Vector2d(firstPt.X - secondPt.X, firstPt.Y - secondPt.Y)
    v2 = rg.Vector2d(firstPt.X - testPt.X, firstPt.Y - testPt.Y)
    
    res = v1.X*v2.Y - v2.X*v1.Y
    print(res > 0)
    return res > 0    




angles = preOrder(LTL, Points)
sortedPoints = sortPoints(angles, Points)

resultPoints = findExtreme(LTL, sortedPoints[-1], sortedPoints[:-1])
# ---------- end graham_scan ----------
pt_2 = Point(graham_scan.resultPoints)
python = PythonScript(Pts=pt_2)  # -> lines; inputs Pts: list of Point3d
# ---------- python: Python ----------
import Rhino.Geometry as rg

lines = []

for i in range(0, len(Pts)-1):
    print(Pts[i])
    line = rg.Line(Pts[i], Pts[i+1])
    lines.append(line)
lastLine = rg.Line(Pts[-1], Pts[0])
lines.append(lastLine)
# ---------- end python ----------
python_2 = PythonScript()  # -> out, a
# ---------- python_2: Python ----------
import Rhino.Geometry as rg
import math

def getAngle(srcPt, p1, p2):
    """Get Angle from 3 Points"""
    #   vector a (x, y) 
    va_x = p1.X - srcPt.X
    va_y = p1.Y - srcPt.Y
    
    #   vector b (x, y)
    vb_x = p2.X - srcPt.X
    vb_y = p2.Y - srcPt.Y
    
    #   production of 2 vectors
    productValue = (va_x * vb_x) + (va_y * vb_y)
    #    print("productValue", productValue)
    #   length va
    va_val = math.sqrt(va_x * va_x + va_y * va_y)
    #   length vb
    vb_val = math.sqrt(vb_x * vb_x + vb_y * vb_y)
    #   cos
    cosValue = productValue/(va_val * vb_val)
    if cosValue == 1:
        angle = 0
    elif cosValue == -1:
        angle = 180
    else:
        angle = math.acos(cosValue)*180/math.pi
    
    return angle
    
ptA = rg.Point2d(0,0)
ptB = rg.Point2d(1,1)
ptC = rg.Point2d(0,1)
res = getAngle(ptA, ptB, ptC)

print(res)
# ---------- end python_2 ----------
