# Grasshopper definition isIntersect.gh (Grasshopper 0.9.76)
# plug-ins: Python Interpreter

ptb1 = Point(<point referenced from the Rhino model>)
pta2 = Point(<point referenced from the Rhino model>)
ptb2 = Point(<point referenced from the Rhino model>)
pta1 = Point(<point referenced from the Rhino model>)
ln = Line(StartPoint=pta1, EndPoint=pta2)
ln_2 = Line(StartPoint=ptb1, EndPoint=ptb2)
isintersect = PythonScript(lineA=ln, lineB=ln_2)  # -> Result
# ---------- isintersect: Python ----------
import Rhino.Geometry as rg
import rhinoscriptsyntax as rs

def isLeft(firstPt, secondPt, testPt):
    v1 = rg.Vector2d(firstPt.X - secondPt.X, firstPt.Y - secondPt.Y)
    v2 = rg.Vector2d(firstPt.X - testPt.X, firstPt.Y - testPt.Y)
    
    res = v1.X*v2.Y - v2.X*v1.Y

    return res > 0 
    


def isIntersect(lineA, lineB):
    ptA1, ptA2 = rs.coerceline(lineA).From, rs.coerceline(lineA).To
    ptB1, ptB2 = rs.coerceline(lineB).From, rs.coerceline(lineB).To

    for ptA in [ptA1, ptA2]:
        for ptB in [ptB1, ptB2]:
            if (ptA.X == ptB.X and ptA.Y == ptB.Y):
                return True

    testA = isLeft(ptA1, ptA2, ptB1) != isLeft(ptA1, ptA2, ptB2)
    testB = isLeft(ptB1, ptB2, ptA1) != isLeft(ptB1, ptB2, ptA2)

    return (testA and testB)
    


Result = isIntersect(lineA, lineB)
# ---------- end isintersect ----------
panel = Panel(isintersect)
