# Grasshopper definition isIntersect3d.gh (Grasshopper 0.9.76)

crv = Curve(<curve referenced from the Rhino model>)
crv_2 = Curve(<curve referenced from the Rhino model>)
c_script = CSharpScript(x=crv, y=crv_2)  # -> out, isIntersect, A, B; inputs x: Curve, y: Curve
# ---------- c_script: C# ----------
    Point3d pt1 = new Point3d(x.PointAtStart.X, x.PointAtStart.Y, x.PointAtStart.Z);
    Point3d pt2 = new Point3d(x.PointAtEnd.X, x.PointAtEnd.Y, x.PointAtEnd.Z);
    Point3d pt3 = new Point3d(y.PointAtStart.X, y.PointAtStart.Y, y.PointAtStart.Z);
    Point3d pt4 = new Point3d(y.PointAtEnd.X, y.PointAtEnd.Y, y.PointAtEnd.Z);

    //if two line segment intersect, they have to be on the same plane.
    Plane plane123 = new Plane(pt1, pt2, pt3);
    int val = (int) plane123.DistanceTo(pt4);

    bool isOnPlane = (val == 0);
    bool testA;
    bool testB;
    Point2d pj1 = new Point2d(0, 0);
    Point2d pj2 = new Point2d(0, 0);
    Point2d pj3 = new Point2d(0, 0);
    Point2d pj4 = new Point2d(0, 0);
    A = isOnPlane;
    if(!isOnPlane){
      isIntersect = false;
    }
    else {
      //project 2 line segment onto XY Plane, if the projected line segment intersects, the origin
      //line segment intersect as well
      pj1.X = pt1.X;
      pj1.Y = pt1.Y;
      pj2.X = pt2.X;
      pj2.Y = pt2.Y;
      pj3.X = pt3.X;
      pj3.Y = pt3.Y;
      pj4.X = pt4.X;
      pj4.Y = pt4.Y;


      testA = isLeft(pj1, pj2, pj3) != isLeft(pj1, pj2, pj4);

      testB = (isLeft(pj3, pj4, pj1) != isLeft(pj3, pj4, pj2));

      bool res = testA && testB;
      isIntersect = res;

    }
# ---------- c_script: C# additional code ----------
  bool isLeft(Point2d Pt_A, Point2d Pt_B, Point2d Pt_C){
    Vector2d v1 = new Vector2d(Pt_A.X - Pt_B.X, Pt_A.Y - Pt_B.Y);
    Vector2d v2 = new Vector2d(Pt_A.X - Pt_C.X, Pt_A.Y - Pt_C.Y);

    double result = v1.X * v2.Y - v2.X * v1.Y;

    return result > 0;

  }
# ---------- end c_script ----------
panel = Panel(c_script.A)
